# Grasshopper definition spin rotation.gh (Grasshopper 1.0.7)

X = Slider(230, range=0..1000)
Y = Slider(220, range=0..1000)
seed = Slider(1, range=0..10)
Z = Slider(351, range=0..1000)
count = Slider(150, range=0..1000)
group = Slider(2, range=0..10)
Z_2 = GetNumber(Z, AtLeast=1, AtMost=1, Maximum=1.797693135e+308, Minimum=-1.797693135e+308)
seed_2 = GetNumber(seed, AtLeast=1, AtMost=1, Maximum=1.797693135e+308, Minimum=-1.797693135e+308)
group_2 = GetNumber(group, AtLeast=1, AtMost=1, Maximum=1.797693135e+308, Minimum=-1.797693135e+308)
count_2 = GetNumber(count, AtLeast=1, AtMost=1, Maximum=1.797693135e+308, Minimum=-1.797693135e+308)
Y_2 = GetNumber(Y, AtLeast=1, AtMost=1, Maximum=1.797693135e+308, Minimum=-1.797693135e+308)
X_2 = GetNumber(X, AtLeast=1, AtMost=1, Maximum=1.797693135e+308, Minimum=-1.797693135e+308)
unit_z = UnitZ(Factor=Z_2)
rectangle = Rectangle(Plane=PlaneXY(0, 0, 0), XSize=X_2, YSize=Y_2, Radius=0)  # -> Rectangle, Length
extrude = Extrude(Base=rectangle.Rectangle, Direction=unit_z)
populate_3d = Populate3D(Region=extrude, Count=count_2, Seed=seed_2)
octree = OcTree(Points=populate_3d, Square=Toggle(True), Group=group_2)  # -> Boxes, Points
box = Box(octree.Boxes)
deconstruct_brep = DeconstructBrep(Brep=box)  # -> Faces, Edges, Vertices
jitter = Jitter(List=box, Jitter=Slider(1, range=0..1), Seed=2)  # -> Values, Indices
split_list = SplitList(List=jitter.Values, Index=Slider(100, range=0..100))  # -> ListA, ListB
pipe = Pipe(Curve=deconstruct_brep.Edges, Radius=Slider(0.3, range=0..1), Caps=Slider(1, range=0..10))
box_2 = Box(split_list.ListB)
box_3 = Box(split_list.ListA)
mesh_brep = MeshBrep(
    Brep=pipe,
    Settings={GridMaxCount=0, GridMinCount=16, JaggedSeams=False, MaxEdgeLength=0, MinEdgeLength=0.0001, MinTolerance=0, Refine=True, RefineAngle=0, RelativeTolerance=0.65, SimplePlanes=True, Tolerance=0})
mesh_brep_2 = MeshBrep(
    Brep=box_3,
    Settings={GridMaxCount=0, GridMinCount=16, JaggedSeams=False, MaxEdgeLength=0, MinEdgeLength=0.0001, MinTolerance=0, Refine=True, RefineAngle=0, RelativeTolerance=0.65, SimplePlanes=True, Tolerance=0})
mesh_brep_3 = MeshBrep(
    Brep=box_2,
    Settings={GridMaxCount=0, GridMinCount=16, JaggedSeams=False, MaxEdgeLength=0, MinEdgeLength=0.0001, MinTolerance=0, Refine=True, RefineAngle=0, RelativeTolerance=0.65, SimplePlanes=True, Tolerance=0})
mesh_colours = MeshColours(Mesh=mesh_brep_2, Colours=ColourSwatch(SwatchColor=RGB(141, 166, 162)))
mesh_colours_2 = MeshColours(Mesh=mesh_brep_3, Colours=ColourSwatch(SwatchColor=RGBA(216, 219, 215, 198)))
mesh_colours_3 = MeshColours(Mesh=mesh_brep, Colours=ColourSwatch(SwatchColor=RGB(0, 0, 0)))

# ---- group: RH_OUT:mesh
mesh = Mesh(flatten(mesh_colours))

mesh_2 = Mesh(flatten(mesh_colours_2))

mesh_3 = Mesh(flatten(mesh_colours_3))
